# Grasshopper definition Day1.gh (Grasshopper 1.0.7)

panel = Panel("30")  # disabled
number_slider = Slider(46, range=0..200)  # disabled
c_script = CSharpScript(iCount=panel)  # -> out, opoints; inputs iCount: Int32; disabled
# ---------- c_script: C# ----------
    Random myRandomGenerator = new Random();
    List<Point3d> points = new List<Point3d>();

    for(int i = 0;i < iCount;i++)
    {
      double x = myRandomGenerator.NextDouble() * 6.0 - 3.0;
      double y = myRandomGenerator.NextDouble() * 6.0 - 3.0;
      double z = myRandomGenerator.NextDouble() * 6.0 - 3.0;
      Point3d myRandomPoint = new Point3d(x, y, z);
      points.Add(myRandomPoint);
    }
    opoints = points;
# ---------- end c_script ----------
# circlr relaxation
c_script_2 = CSharpScript(iCount="50")  # -> out, opoints; inputs iCount: Int32
# ---------- c_script_2: C# ----------
    Random myRandomGenerator = new Random();
    List<Point3d> points = new List<Point3d>();

    for(int i = 0;i < iCount;i++)
    {
      double x = myRandomGenerator.NextDouble() * 6.0 - 3.0;
      double y = myRandomGenerator.NextDouble() * 6.0 - 3.0;
      double z = 0.0;
      Point3d myRandomPoint = new Point3d(x, y, z);
      points.Add(myRandomPoint);
    }
    opoints = points;
# ---------- end c_script_2 ----------
number_slider_2 = Slider(1, range=0..1)  # disabled
number_slider_3 = Slider(0, range=0..1)  # disabled
c_script_3 = CSharpScript(iStartingPoints=c_script.opoints, iIterationCount=number_slider)  # -> out, oGeometry; inputs iStartingPoints: list of Point3d, iIterationCount: Int32; disabled
# ---------- c_script_3: C# ----------
    List<Point3d> centers = new List<Point3d>(iStartingPoints);//center列表与iStartingPoint列表是两个独立的副本
    for(int iteration = 0;iteration < iIterationCount;iteration++)
    {
      List<Vector3d> totalMoves = new List<Vector3d>();
      List<double> collisionCounts = new List<double>();

      //每一个点的移动是move，所有点的move的集合是totalMoves
      //先初始化设置move的集合totalMoves都为零向量
      for(int i = 0;i < centers.Count;i++)
      {
        totalMoves.Add(new Vector3d(0.0, 0.0, 0.0));
        collisionCounts.Add(0.0);
      }

      double distanceShouldBe = 2.0;

      for(int i = 0;i < centers.Count;i++)
      {
        for(int j = i + 1;j < centers.Count;j++)
        {
          double distance = centers[i].DistanceTo(centers[j]);//圆半径的两倍
          if(distanceShouldBe <= distance) continue;//continue只会跳出当前这个循环，即离它最近的循环
          Vector3d move = centers[i] - centers[j];
          move.Unitize();
          move *= (distanceShouldBe - distance) * 0.5;
          //每次计算产生的向量直接叠加
          //同时在计算i的时候吧j也计算了，i永远在j前面,所以在轮到j的时候就不用再考虑跟前面的i再计算了
          totalMoves[i] += move;
          totalMoves[j] -= move;
          collisionCounts[i] += 1.0;
          collisionCounts[j] += 1.0;
        }
      }

      for(int i = 0;i < centers.Count;i++)
      {
        if(collisionCounts[i] != 0)
        {
          Vector3d averageMove = totalMoves[i] / collisionCounts[i];
          centers[i] += averageMove;
        }
      }
    }
    oGeometry = centers;
# ---------- end c_script_3 ----------
c_script_4 = CSharpScript(iStartingPoints=c_script_2.opoints, iIterationCount=Slider(37, range=0..200))  # -> out, oGeometry; inputs iStartingPoints: list of Point3d, iIterationCount: Int32; same code as c_script_3
vec = VectorXYZ(XComponent=number_slider_2, YComponent=number_slider_3, ZComponent=0)  # -> Vector, Length; disabled
number_slider_4 = Slider(1, range=0..1)  # disabled
toggle = BooleanToggle(True)  # disabled
toggle_2 = BooleanToggle(True)  # disabled
# Persistent data in the C# Script Component
toggle_3 = BooleanToggle(True)  # disabled
toggle_4 = BooleanToggle(True)  # disabled
toggle_5 = BooleanToggle(True)  # disabled
# DeCasteljauAlgorithm
# Generate random points within a predefined range
number_slider_5 = Slider(0.26, range=0.01..1)  # disabled
timer = Timer(TimerInterval=100, Target=c_script_5)  # disabled
timer_2 = Timer(TimerInterval=100, Target=c_script_6)  # disabled
timer_3 = Timer(TimerInterval=1000, Target=c_script_7)  # disabled
timer_4 = Timer(TimerInterval=100, Target=c_script_8)  # disabled
timer_5 = Timer(TimerInterval=20, Target=c_script_9)  # disabled
number_slider_6 = Slider(7, range=0..10)  # disabled
panel_2 = Panel(c_script_4.oGeometry)
panel_3 = Panel(c_script_3.oGeometry)  # disabled
c_script_5 = CSharpScript(iReset=toggle)  # -> out, A; inputs iReset: Boolean; disabled
# ---------- c_script_5: C# ----------
    if(iReset)
    {
      position = new Point3d(0, 0, 0);
      positions = new List<Point3d>();

      for (int i = 0;i < 10;i++)
      {
        positions.Add(new Point3d(0, 0, 0));
      }
    }
    else
    {
      double x = random.NextDouble() - 0.5;
      double y = random.NextDouble() - 0.5;


      position += new Vector3d(x, y, 0);
      positions.Add(position);
      positions.RemoveAt(0);//因为是每次都移走第一项，所以列表中会始终保持含有10项

    }

    A = positions;
# ---------- c_script_5: C# additional code ----------
  Point3d position = new Point3d(0, 0, 0);
  Random random = new Random();
  List<Point3d> positions = new List<Point3d>();
# ---------- end c_script_5 ----------
c_script_6 = CSharpScript(iReset=toggle_2, iVelocity=vec.Vector)  # -> out, A; inputs iReset: Boolean, iVelocity: Vector3d; disabled
# ---------- c_script_6: C# ----------
    if(iReset)
      position = new Point3d(0, 0, 0);
    else
      position += iVelocity;

    A = position;
# ---------- c_script_6: C# additional code ----------
  Point3d position = new Point3d(0, 0, 0);
# ---------- end c_script_6 ----------
c_script_7 = CSharpScript(iReset=toggle_3)  # -> out, A; inputs iReset: Boolean; disabled
# ---------- c_script_7: C# ----------
    if(iReset)
      n = 0;
    else
      n += 1;
    
    A = new Point3d(n, n, 0);

    Print(n.ToString());
# ---------- c_script_7: C# additional code ----------
  int n = 0;
# ---------- end c_script_7 ----------
c_script_8 = CSharpScript(iReset=toggle_4)  # -> out, A; inputs iReset: Boolean; disabled
# ---------- c_script_8: C# ----------
    if(iReset)
    {
      position = new Point3d(0, 0, 0);
      positions = new List<Point3d>();
    }
    else
    {
      double x = random.NextDouble() - 0.5;
      double y = random.NextDouble() - 0.5;


      position += new Vector3d(x, y, 0);
      positions.Add(position);

    }

    A = positions;
# ---------- c_script_8: C# additional code ----------
  Point3d position = new Point3d(0, 0, 0);
  Random random = new Random();
  List<Point3d> positions = new List<Point3d>();
# ---------- end c_script_8 ----------
c_script_9 = CSharpScript(iReset=toggle_5)  # -> out, A; inputs iReset: Boolean; disabled
# ---------- c_script_9: C# ----------
    if(iReset)
      position = new Point3d(0, 0, 0);
    else
      position += new Vector3d(0.1, 0.2, 0);

    A = position;
# ---------- c_script_9: C# additional code ----------
  Point3d position = new Point3d(0, 0, 0);
# ---------- end c_script_9 ----------
curve = Curve(reparameterize(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))  # disabled
number_slider_7 = Slider(1, range=0..1)  # disabled
number_slider_8 = Slider(0.6, range=0..1)  # disabled
number_slider_9 = Slider(0.6, range=0..1)  # disabled
sph = Sphere(Base=c_script_3.oGeometry, Radius=number_slider_4)  # disabled
cir = Circle(Plane=c_script_4.oGeometry, Radius=Slider(1, range=0..1))
point = Point([Point(-15.68717932, -11.71483186, 0), Point(-5.474729209, 14.53982706, 0), Point(11.39020952, -16.86131729, 0), Point(21.89493407, 19.12448436, 0), Point(40.92752445, 3.950505155, 0)])  # disabled
c_script_10 = CSharpScript(iCount="200")  # -> out, opoints; inputs iCount: Int32; disabled; same code as c_script_2
panel_4 = Panel(c_script_7.out)  # disabled
c_script_11 = CSharpScript(curve=curve, tolerance=number_slider_5)  # -> out, outputSegments; inputs curve: Curve, tolerance: Double; disabled
# ---------- c_script_11: C# ----------
    List<LineCurve> segments = new List<LineCurve>();
    DivideCurve(curve, 0.0, 1.0, tolerance, segments);
    outputSegments = segments;
# ---------- c_script_11: C# additional code ----------
  void DivideCurve(Curve curve, double tStart, double tEnd, double tolerance, List<LineCurve> segments)
  {
    Point3d startPoint = curve.PointAt(tStart);
    Point3d endPoint = curve.PointAt(tEnd);
    Point3d middlePoint = 0.5 * (startPoint + endPoint);

    double tClosest;
    curve.ClosestPoint(middlePoint, out tClosest);

    double distance = curve.PointAt(tClosest).DistanceTo(middlePoint);

    if(distance < tolerance)
      segments.Add(new LineCurve(startPoint, endPoint));
    else
    {
      double tMiddle = 0.5 * (tStart + tEnd);
      DivideCurve(curve, tStart, tMiddle, tolerance, segments);
      DivideCurve(curve, tMiddle, tEnd, tolerance, segments);
    }


  }
# ---------- end c_script_11 ----------
pline = PolyLine(Vertices=c_script_5.A, Closed=False)  # disabled
c_script_12 = CSharpScript()  # -> out, A; disabled
# ---------- c_script_12: C# ----------
    Random myRandomGenerator = new Random();//括号中可以输入参数seed，如果不指定seed，则会自动根据系统的时钟生成

    for(int i = 0;i < 10;i++)
    {
      double myRandomNumber = myRandomGenerator.NextDouble();//返回0-1之间的随机double数，如果想要0-13.5之间的就*13.5
      
      double a = myRandomNumber * 6 - 3;//返回-3到3之间的随机double数
      
      Print(myRandomNumber.ToString());
    }
# ---------- end c_script_12 ----------
point_2 = Point([Point(-7.14606524, -3.245882489, 0), Point(-7.14606524, 10.3738791, 0), Point(-7.14606524, 18.12680552, 0), Point(22.76475447, 18.12680552, 0), Point(22.76475447, -6.142719329, 0), Point(0.02500870355, -6.142719329, 0), Point(0.02500870355, 9.249413509, 0), Point(9.981301799, 9.249413509, 0), Point(9.981301799, -3.874843306, 0), Point(4.0553047, -3.874843306, 0), Point(4.0553047, 4.906047596, 0), Point(14.65194975, 4.906047596, 0)])  # disabled
pline_2 = PolyLine(Vertices=c_script_8.A, Closed=False)  # disabled
c_script_13 = CSharpScript(controlPoints=point, iterationCount=number_slider_6)  # -> out, curve; inputs controlPoints: list of Point3d, iterationCount: Int32; disabled
# ---------- c_script_13: C# ----------
    for(int j = 0;j < iterationCount;j++)
    {
      List<Point3d> newControlPoints = new List<Point3d>();
      for(int i = 0;i < controlPoints.Count - 1;i++)
      {
        Point3d oneQuarterPoint = 0.75 * controlPoints[i] + 0.25 * controlPoints[i + 1];
        newControlPoints.Add(oneQuarterPoint);

        Point3d threeQuarterPoint = 0.25 * controlPoints[i] + 0.75 * controlPoints[i + 1];
        newControlPoints.Add(threeQuarterPoint);
      }

      controlPoints = newControlPoints;
    }

    curve = new PolylineCurve(controlPoints);
# ---------- end c_script_13 ----------

c_script_14 = CSharpScript()  # -> out, A; disabled
# ---------- c_script_14: C# ----------
    List<string> myTexts = new List<string>();
    Print(myTexts.Count.ToString());
    Foo(myTexts);
    Print(myTexts.Count.ToString());
# ---------- c_script_14: C# additional code ----------
  void Foo(List<string> texts)
  {
    texts.Add("Oh,Yeah!!!");
  }
# ---------- end c_script_14 ----------
c_script_15 = CSharpScript()  # -> out, A; disabled
# ---------- c_script_15: C# ----------
    double myNumber = 2.0;
    Foo(myNumber);
    Print(myNumber.ToString());
# ---------- c_script_15: C# additional code ----------
  void Foo(double someNumber)
  {
    someNumber = someNumber + 1.0;
  }
# ---------- end c_script_15 ----------

c_script_16 = CSharpScript()  # -> out, A; disabled
# ---------- c_script_16: C# ----------
    double result = ComputeCylinderVolume(2.0, 2.0);
    Print(result.ToString());
# ---------- c_script_16: C# additional code ----------
  double ComputeCylinderVolume(double r, double h)
  {
    return 3.14 * r * r * h;
  }
# ---------- end c_script_16 ----------
c_script_17 = CSharpScript()  # -> out, A; disabled
# ---------- c_script_17: C# ----------
    double result = ComputeCylinderVolume(2.0, 2.0);
    Print(result.ToString());
# ---------- c_script_17: C# additional code ----------
  double ComputeCylinderVolume(double r, double h)
  {
    double baseArea = ComputeCircleArea(r);
    return baseArea * h;
  }

  double ComputeCircleArea(double r)
  {
    return r * r * 3.14;
  }
# ---------- end c_script_17 ----------

c_script_18 = CSharpScript(points=point_2)  # -> out, A; inputs points: list of Point3d; disabled
# ---------- c_script_18: C# ----------
    List<Circle> circles = new List<Circle>();
    
    foreach (Point3d point in points)
    {
      Circle circle = new Circle(point, 2.0);
      circles.Add(circle);
    }
    A = circles;
# ---------- end c_script_18 ----------
c_script_19 = CSharpScript(x=number_slider_7, y=number_slider_8, z=number_slider_9)  # -> out, A, B; inputs x: Double, y: Double, z: Double; disabled
# ---------- c_script_19: C# ----------
    A = x + y;
    B = x + y + z;
# ---------- end c_script_19 ----------
c_script_20 = CSharpScript()  # -> out, A; disabled
# ---------- c_script_20: C# ----------
    Point3d myPoint = new Point3d(1.0, 2.0, 3.0);
    A = myPoint;
# ---------- end c_script_20 ----------
c_script_21 = CSharpScript()  # -> out, A; disabled
# ---------- c_script_21: C# ----------
    List<Point3d> myPoints = new List<Point3d>();
    //myPoints.Add(new Point3d(2.0, 1.0, 2.0));//向myPoints列表中添加一个点
    //myPoints.Add(new Point3d(2.0, 1.0, 5.0));

    //for(int i = 0;i < 100;i++)
    //{
    //  Point3d point = new Point3d(i, i, i);
    //  myPoints.Add(point);
    //}

    for(int i = 0;i < 100;i++)
    {
      for(int j = 0;j < 20;j++)
      {
        myPoints.Add(new Point3d(i, j, 0));
      }
    }

    A = myPoints;
# ---------- end c_script_21 ----------
panel_5 = Panel(c_script_12.out)  # disabled
panel_6 = Panel(c_script_19.A)  # disabled
